# Grasshopper definition CreateWall.gh (Grasshopper 1.0.7)
# plug-ins: BasementWall

brep = Brep([<brep referenced from the Rhino model> x3])
bw = BasementWall(Wall=brep, Thickness=Slider(500, range=0..1000), Offset=Slider(0, range=0..1000))
